# Dynamo graph ImportExport_CSV to Stuff.dyn (Dynamo 0.8.0.706)

# note: 浏览在 X、Y 和 Z 轴坐标空间具有数字
# 的 CSV 文件
file_path = Filename("C:\ProgramData\Dynamo\0.9\samples\Data\helix.csv")
fromPath = FileObject(file_path)  # "File.FromPath"
readText = File.ReadText(fromPath)
string = StringInput("\n")
# note: 以回车符<enter>
# 拆分字符串
split = String.Split(readText, string)
string_2 = StringInput(",")
# note: 以逗号分隔字符串
split_2 = String.Split(split, string_2)
# note: CSV 文件提供字符串，而不是数字
toNumber = String.ToNumber(split_2)
# note: 组 X、Y 和 Z 分量
transpose = List.Transpose(toNumber)
firstItem = List.FirstItem(transpose)
code_block = CodeBlock { 1; }
getItemAtIndex = List.GetItemAtIndex(list=transpose, index=code_block)
lastItem = List.LastItem(transpose)
byCoordinates = Point.ByCoordinates(x=firstItem, y=getItemAtIndex, z=lastItem)
number_slider = DoubleSlider(2.337, range=0..20 step 0.1)
# note: 调整坐标点的
# 总分布
scale = Geometry.Scale(geometry=byCoordinates, amount=number_slider, lacing=Longest)
