# Dynamo graph Core_AttractorPoint.dyn (Dynamo 0.8.0.684)

# note: 范围语法: 1 到 50，按 5 跳跃
# note: 吸引器点
# 脚本 101。
# 使用吸引器点可以快速生成一整片对象的不同变体。其工作方式是为这些对象创建一个网格，其中部分参数由对象和在对象周围运动的点之间的距离来确定。
# 若要将对象最新进展可视化，请移动控制吸引器点位置的两个滑块。
number = DoubleInput(1..50..5)
# note: 点的网格。
# 若要生成，请将一系列数字传入至少两个端口。将节点的连缀行为更改为“叉积”
byCoordinates = Point.ByCoordinates(x=number, y=number, lacing=CrossProduct)
# note: 展平列表，因为无需行和列的层次结构。比较该节点的输入和输出。
flatten = Flatten(byCoordinates)
code_block = CodeBlock { 0; }
number_slider = DoubleSlider(28.6701556, range=-10..60 step 0.1)
number_slider_2 = DoubleSlider(11.50111001, range=-10..60 step 0.1)
# note: 吸引器点。移动输入滑块以调整该点的位置。
byCoordinates_2 = Point.ByCoordinates(x=number_slider, y=number_slider_2)
# note: 查找吸引器点与圆柱体基准点之间的距离
distanceTo = Geometry.DistanceTo(geometry=flatten, other=byCoordinates_2, lacing=Longest)
# note: 公式用于使圆柱体高度随吸引器点的位置而变化。可不同于控制半径所用的公式。
code_block_2 = CodeBlock(x=distanceTo) { x/2; }
byCoordinates_3 = Vector.ByCoordinates(x=code_block, y=code_block, z=code_block_2)
# note: 将新 Z 值(高度)添加到原网格点以获得圆柱体顶点。
add = Point.Add(point=flatten, vectorToAdd=byCoordinates_3)
# note: 公式调整各圆柱体半径之间的变化量。尝试使用不同公式。
code_block_3 = CodeBlock(x=distanceTo) { x/15; }
byPointsRadius = Cylinder.ByPointsRadius(flatten, add, code_block_3)
