# Dynamo graph Geometry_Points.dyn (Dynamo 0.8.0.760)

number_slider = DoubleSlider(5.638, range=0..10 step 0.1)
# note: 基本几何图形图元具有数字输入的默认值。
byCoordinates = Point.ByCoordinates(z=number_slider)
# note: 单击“运行”或在启用“自动运行”后，可在背景预览、Watch 3d 中或作为数据在“观看”节点中查看几何图形实体。在选定节点后，图元将在背景中高亮显示
watch_3d = Watch3D(byCoordinates)
number = DoubleInput(0)
number_2 = DoubleInput(10)
number_3 = DoubleInput(1)
# note: 使用序列、范围和列表可创建几何图形数组
number_range = NumberRange(number, number_2, number_3, lacing=Longest)
# note: 通过将“范围”传递到点 X、Y 和 Z 端口生成 1、2 和 3 维数组，然后在节点的右键菜单中更改连缀特性
byCoordinates_2 = Point.ByCoordinates(y=number_range)
watch = Watch(byCoordinates)
asVector = Point.AsVector(watch)
# note: 在实体的“操作”子目录中使用工具，可以创建导数图元
add = Point.Add(point=byCoordinates_2, vectorToAdd=asVector)
# note: 在实体的“查询”子目录中使用工具，可以从几何图形提取出信息
Z = Point.Z(byCoordinates)
