# Dynamo graph Geometry_Curves.dyn (Dynamo 0.8.0.760)

byCoordinates = Point.ByCoordinates()
number = DoubleInput(5)
byCoordinates_2 = Point.ByCoordinates(y=number)
number_2 = DoubleInput(10)
byCoordinates_3 = Point.ByCoordinates(x=number_2, y=number_2)
number_3 = DoubleInput(15)
byCoordinates_4 = Point.ByCoordinates(x=number_3)
create = List.Create(byCoordinates, byCoordinates_2, byCoordinates_3, byCoordinates_4)
byPoints = NurbsCurve.ByPoints(create)
# note: 大多数曲线有多种创建方法。
byStartPointEndPoint = Line.ByStartPointEndPoint(startPoint=byCoordinates, endPoint=byCoordinates_2)
length = Curve.Length(byStartPointEndPoint)
boolean = BoolSelector(true)
byControlPoints = NurbsCurve.ByControlPoints(create, arg2=boolean)
byPoints_2 = PolyCurve.ByPoints(points=create)
code_block = CodeBlock { 0..1..#20; }
# note: 曲线、Polycurves (曲线集合)、Nurbs 和直线均源自于“曲线”，因此可以对它们进行所有相关的曲线“操作”和“查询”
pointAtParameter = Curve.PointAtParameter(curve=byPoints_2, param=code_block)
# note: 将任何曲线图元传递到 Revit 图元，这些 Revit 图元由用于创建 Revit 图元的直线或其他曲线驱动
byCurve = ModelCurve.ByCurve()
