# Dynamo graph Core_CodeBlocks.dyn (Dynamo 0.8.0.684)

# note: 定义函数的代码块节点没有输入或输出端口，因为它们是从其他代码块节点调用的。

# note: 同时，这些语句形成在基准点创建螺旋曲线的算法。
code_block = CodeBlock()
# ---------- code_block.designscript (16 lines) ----------
// Basic inputs
base = Point.ByCoordinates(3,3);
coils = 3;
height = 5;
rad = 0.5;

// Make a series of points
numPts = 8*coils + 1;
seq = 0..(coils*360)..#numPts;
x = rad * Math.Cos(seq);
y = rad * Math.Sin(seq);
z = 0..height..#numPts;
pts = Point.ByCoordinates(x + base.X, y + base.Y, z + base.Z);

// Pass a curve through those points
NurbsCurve.ByPoints(pts);
# ----------------------------------------
# note: 通过给定名称、指定输入和指示返回结果，将螺旋算法转换为一个函数。
code_block_2 = CodeBlock()
# ---------- code_block_2.designscript (13 lines) ----------
def MakeSpring(base,coils,height,rad)
{
// Make a series of points
numPts = 8*coils + 1;
seq = 0..(coils*360)..#numPts;
x = rad * Math.Cos(seq);
y = rad * Math.Sin(seq);
z = 0..height..#numPts;
pts = Point.ByCoordinates(x + base.X, y + base.Y, z + base.Z);

// Return the curve that passes through those points
return = NurbsCurve.ByPoints(pts);
};
# ----------------------------------------
# note: 对螺旋算法进行转换，以定义具有任意名称的函数“MakeSpring”。调用该函数可生成多个弹簧，这些弹簧具有随机高度，并以网格的形式布置。
code_block_3 = CodeBlock { 0..6..2; }
code_block_4 = CodeBlock { 10..20..2; }
# note: 生成网格
byCoordinates = Point.ByCoordinates(x=code_block_3, y=code_block_4, lacing=CrossProduct)
flatten = Flatten(byCoordinates)
code_block_5 = CodeBlock { 5; }
count = Count(flatten)
# note: 生成一系列随机数字(以 5 为比例)用作弹簧高度
randomList = Math.RandomList(count)
code_block_6 = CodeBlock(random=randomList) { random * 5; }
# note: 内容列表或单值项可用于函数调用的输入。数据可通过端口传入到或直接声明，例如所有弹簧的半径为“0.5”。
code_block_7 = CodeBlock(basePoints=flatten, numCoils=code_block_5, height=code_block_6) { MakeSpring(basePoints,numCoils,height,0.5); }
# note: 函数可在“代码块”节点中直接定义，并可在该定义的任意位置调用。
# 第一行包含关键字“默认”，接着是函数名，然后是括号中的输入。
# 大括号定义函数的主体。每行都必须以分号结尾。
# 返回值具有“Return = ”。
code_block_8 = CodeBlock()
# ---------- code_block_8.designscript (11 lines) ----------
/* This is a multi-line comment,
     which continues for mulitple
     lines. */

def FunctionName(input1, input2)
{
// This is a comment
sum = input1 + input2;

return = sum;
};
# ----------------------------------------
# note: 通过提供相同名称和相同数量的参数，调用同一文件中具有另一代码块节点的函数。
code_block_9 = CodeBlock { 1; }
code_block_10 = CodeBlock { 2; }
code_block_11 = CodeBlock(in1=code_block_9, in2=code_block_10) { FunctionName(in1,in2); }
watch = Watch(code_block_11)
# note: 函数定义中未指定输入参数的类型，因此将运算接收到的所有数据。
code_block_12 = CodeBlock { "cat"; }
code_block_13 = CodeBlock { "dog"; }
code_block_14 = CodeBlock(in1=code_block_12, in2=code_block_13) { FunctionName(in1,in2); }
watch_2 = Watch(code_block_14)
# note: 对于对函数没有意义的输入，函数调用所产生的结果为空。
origin = Point.Origin()
code_block_15 = CodeBlock { 16; }
code_block_16 = CodeBlock(in1=origin, in2=code_block_15) { FunctionName(in1,in2); }
watch_3 = Watch(code_block_16)
# note: 代码块
# 通过在画布中双击可生成代码块，它们也与其他节点一起位于库中。
# 代码块可包含数字、字符串和公式。请参见数学样例文件，了解带公式节点的数学与代码块之间的差异。
number = DoubleInput(3.14)
watch_4 = Watch(number)
string = StringInput("Less is more.")
watch_5 = Watch(string)
formula = Formula("3*5")
watch_6 = Watch(formula)
code_block_17 = CodeBlock { "Less is more."; }
# note: 使用引号 "" 以生成字符串。
watch_7 = Watch(code_block_17)
# note: 有关详细信息，请查看:
# http://dynamobim.org/cbns-for-dummies/
code_block_18 = CodeBlock { 3.142; }
watch_8 = Watch(code_block_18)
code_block_19 = CodeBlock { 3*5; }
watch_9 = Watch(code_block_19)
# note: 通过代码块，用户可以灵活地决定如何指定输入内容。以下是几种不同的方法，例如，用于生成相同的点。
code_block_20 = CodeBlock { 10; }
code_block_21 = CodeBlock { -10; }
byCoordinates_2 = Point.ByCoordinates(x=code_block_20, y=code_block_21)
watch_10 = Watch(byCoordinates_2)
code_block_22 = CodeBlock(x=code_block_20, y=code_block_21) { z = 0; Point.ByCoordinates(x,y,z); }
watch_11 = Watch(code_block_22.out1)
# note: 创建类方法函数即使没有输入内容，仍需使用括号。
origin_2 = Point.Origin()
watch_12 = Watch(origin_2)
code_block_23 = CodeBlock { Point.Origin(); }
watch_13 = Watch(code_block_23)
# note: 查询。
# 查询类方法函数获取对象的特性，因此无需任何输入内容。
code_block_24 = CodeBlock { Point.ByCoordinates(10,0,0); }
code_block_25 = CodeBlock(pt=code_block_24) { pt.X; }
watch_14 = Watch(code_block_25)
X = Point.X(code_block_24)
watch_15 = Watch(X)
code_block_26 = CodeBlock(num=code_block_20) { Point.ByCoordinates(num,-num,0); }
watch_16 = Watch(code_block_26)
code_block_27 = CodeBlock { Point.ByCoordinates(10,-10,0); }
watch_17 = Watch(code_block_27)
# note: 代码块可用于调用库中的任何其他节点。节点在库中通常有三种类型:
#     创建: 创建对象
#     操作: 对对象执行操作
#     查询:  获取已存在对象
#   的特性
# 这三种类型的方法函数或节点在代码块内调用时会以不同的方式进行处理。
# note: 创建。
# 使用方法函数来创建对象时，请通过名称调用，然后按即时可用节点中的顺序指定输入。
code_block_28 = CodeBlock { 0; -10; }
byCoordinates_3 = Point.ByCoordinates(x=code_block_28.out0, y=code_block_28.out1)
watch_18 = Watch(byCoordinates_3)
code_block_29 = CodeBlock { Point.ByCoordinates(0,-10); }
watch_19 = Watch(code_block_29)
# note: 操作。
# 操作的执行针对该类型的对象。在对象本身之后使用点表示法，指定即时可用节点上找到的所有输入(第一个除外，因为第一个输入端口是对象本身，它已经存在！)
origin_3 = Point.Origin()
ZAxis = Vector.ZAxis()
add = Point.Add(point=origin_3, vectorToAdd=ZAxis)
watch_20 = Watch(add)
origin_4 = Point.Origin()
ZAxis_2 = Vector.ZAxis()
code_block_30 = CodeBlock(pt=origin_4, vec=ZAxis_2) { pt.Add(vec); }
watch_21 = Watch(code_block_30)
# note: 生成带大括号的列表。
code_block_31 = CodeBlock { {"San Francisco","New York","Chicago"}; }
watch_22 = Watch(code_block_31)
# note: 从带括号的列表获取项。
code_block_32 = CodeBlock(cities=watch_22) { cities[2]; }
watch_23 = Watch(code_block_32)
code_block_33 = CodeBlock()
# ---------- code_block_33.designscript (7 lines) ----------
str0 = "alpha";
str1 = "beta";
str2 = "charlie";
str3 = "delta";
str4 = "echo";
//
{str0,str1,str2,str3,str4};
# ----------------------------------------
watch_24 = Watch(code_block_33.out5)
code_block_34 = CodeBlock(phonetic=watch_24) { phonetic[2..3]; }
watch_25 = Watch(code_block_34)
# note: 创建嵌套列表并从嵌套列表获取项。
code_block_35 = CodeBlock()
# ---------- code_block_35.designscript (6 lines) ----------
kitchen = {"table","stove","sink","refrigerator"};
livingRoom = {"sofa","books"};
bedroom = {"bed","dirty clothes"};
bathroom = {"tooth brush"};
//
allMyStuff = {kitchen, livingRoom, bedroom, bathroom};
# ----------------------------------------
watch_26 = Watch(code_block_35.allMyStuff)
code_block_36 = CodeBlock(list=watch_26) { list[2][1]; }
watch_27 = Watch(code_block_36)
# note: 复制导向可用于指定将列表连缀为“叉积”
code_block_37 = CodeBlock { x_vals = 0..10; y_vals = -30..-40; }
code_block_38 = CodeBlock(x_vals=code_block_37.x_vals, y_vals=code_block_37.y_vals) { Point.ByCoordinates(x_vals, y_vals); }
code_block_39 = CodeBlock { x_vals = 0..10; y_vals = -15..-25; }
code_block_40 = CodeBlock(x_vals=code_block_39.x_vals, y_vals=code_block_39.y_vals) { Point.ByCoordinates(x_vals<1>, y_vals<2>); }
byCoordinates_4 = Point.ByCoordinates(x=code_block_37.x_vals, y=code_block_37.y_vals)
byCoordinates_5 = Point.ByCoordinates(x=code_block_39.x_vals, y=code_block_39.y_vals, lacing=CrossProduct)
# note: 复制导向使用尖括号，获取两到三个一维集合，然后将
# 图元搭配在一起以生成一维、两维或三维集合。
code_block_41 = CodeBlock()
# ---------- code_block_41.designscript (5 lines) ----------
x_vals = 0..1;
y_vals = -3..-7;
//
Point.ByCoordinates(x_vals<1>, y_vals<2>);
Point.ByCoordinates(x_vals<2>, y_vals<1>);
# ----------------------------------------
watch_28 = Watch(code_block_41.out2)
# note: 在本示例中，有 2 个 X 值和 5 个 Y 值。复制导向可以指定，生成的组合为 5 个点的 2 个列表或 2 个点的 5 个列表。
watch_29 = Watch(code_block_41.out3)
