# Dynamo graph Revit_Adaptive Component Placement.dyn (Dynamo 0.8.0.760)

# note: 已从 Revit 预选模型线，图元 ID 与 Dynamo 文件一起保存
# note: 运行该图形 DynamoSample.rvt 文件，该文件位于 Dynamo 安装文件的 Samples 文件夹中
# C:\ProgramData\Dynamo\(Dynamo 版本)\samples\Revit
# note: 相对于 Revit 文件中选定的某些图元布置自适应构件
select_model_element = DSModelElementSelection()  # 1 picked in the model
select_model_element_2 = DSModelElementSelection()  # 1 picked in the model
select_model_element_3 = DSModelElementSelection()  # 1 picked in the model
create_list = List.Create(select_model_element, select_model_element_2, select_model_element_3)
geometry = Element.Geometry(create_list)
flatten = Flatten(geometry)
integer_slider = IntegerSlider(9, range=2..10 step 1)
code_block = CodeBlock(x=integer_slider) { 0..1..#x; }
pointAtParameter = Curve.PointAtParameter(curve=flatten, param=code_block, lacing=CrossProduct)
transpose = Transpose(pointAtParameter)
family_types = FamilyTypes("3PointAC_SquareTruss:3PointAC_SquareTruss")
byPoints = AdaptiveComponent.ByPoints(transpose, family_types)
byPoints_2 = PolyCurve.ByPoints(points=transpose)
