# Dynamo graph Revit_ImportSolid.dyn (Dynamo 0.8.0.760)

# note: 已从 Revit 预选模型线，图元 ID 与 Dynamo 文件一起保存
# note: 运行该图形 DynamoSample.rvt 文件，该文件位于 Dynamo 安装文件的 Samples 文件夹中
# C:\ProgramData\Dynamo\(Dynamo 版本)\samples\Revit
# note: 将实心形状导入 Revit
select_model_element = DSModelElementSelection()  # 1 picked in the model
curve = CurveElement.Curve(select_model_element)
code_block = CodeBlock { 0..1..#9; }
pointAtParameter = Curve.PointAtParameter(curve=curve, param=code_block)
select_model_element_2 = DSModelElementSelection()  # 1 picked in the model
curve_2 = CurveElement.Curve(select_model_element_2)
pointAtParameter_2 = Curve.PointAtParameter(curve=curve_2, param=code_block)
select_model_element_3 = DSModelElementSelection()  # 1 picked in the model
curve_3 = CurveElement.Curve(select_model_element_3)
pointAtParameter_3 = Curve.PointAtParameter(curve=curve_3, param=code_block)
byThreePoints = Arc.ByThreePoints(firstPoint=pointAtParameter, secondPoint=pointAtParameter_2, thirdPoint=pointAtParameter_3)
number = DoubleInput(1)
extendStart = Curve.ExtendStart(curve=byThreePoints, distance=number)
extendEnd = Curve.ExtendEnd(curve=extendStart, distance=number)
byLoft = Surface.ByLoft(extendEnd)
number_2 = DoubleInput(0.5)
thicken = Surface.Thicken(surface=byLoft, thickness=number_2)
byGeometries = ImportInstance.ByGeometries(thicken)
