# Dynamo graph Revit_PlaceFamiliesByLevel_Set Parameters.dyn (Dynamo 0.8.0.760)

# note: 运行该图形 DynamoSample.rvt 文件，该文件位于 Dynamo 安装文件的 Samples 文件夹中
# C:\ProgramData\Dynamo\(Dynamo 版本)\samples\Revit
# note: 布置多个太阳能电池板并将唯一数字写入其标记参数
family_types = FamilyTypes("Photovoltaic-Panel-SolarWorld-SunModule-(235-240):SunModule SW 245 Silver Mono - 10 Deg. Angle")
code_block = CodeBlock { -10; 10; 2.5; }
number_range = NumberRange(code_block.out0, code_block.out1, code_block.out2, lacing=Longest)
code_block_2 = CodeBlock { -10..-15..#3; }
byCoordinates = Point.ByCoordinates(x=number_range, y=code_block_2, lacing=CrossProduct)
flatten = Flatten(byCoordinates)
levels = Levels("Level 1 Living Rm.")
# note: 布置族实例
# 大多数族还可以通过点的位置来布置。自适应构件可通过多个点来布置，结构框架通过曲线来布置
byPointAndLevel = FamilyInstance.ByPointAndLevel(family_types, flatten, levels)
string = StringInput("Mark")
number = DoubleInput(1)
count = Count(byPointAndLevel)
number_sequence = NumberSeq(number, count, number, lacing=Longest)
string_from_object = FromObject(number_sequence)
# note: 设置每个族实例参数。如果使用相同模型，还可以使用 Element。GetParameterByName 读取参数
setParameterByName = Element.SetParameterByName(element=byPointAndLevel, parameterName=string, value=string_from_object)
