# Dynamo graph BeamsNetwork.dyn (Dynamo 0.9.0.3011)

number_slider = DoubleSlider(0, range=0..100 step 0.1)
number_slider_2 = DoubleSlider(7, range=0..100 step 0.1)
number_slider_3 = DoubleSlider(0, range=0..100 step 0.1)
byCoordinates = Point.ByCoordinates(x=number_slider, y=number_slider_2, z=number_slider_3)
number_slider_4 = DoubleSlider(20, range=0..100 step 0.1)
byCoordinates_2 = Point.ByCoordinates(x=number_slider_4, y=number_slider_2, z=number_slider_3)
number_slider_5 = DoubleSlider(12, range=10..20 step 0.1)
number_slider_6 = DoubleSlider(-10, range=-10..10 step 0.1)
byCoordinates_3 = Point.ByCoordinates(x=number_slider, y=number_slider_5, z=number_slider_6)
number_slider_7 = DoubleSlider(8, range=0..10 step 0.1)
byCoordinates_4 = Point.ByCoordinates(x=number_slider_4, y=number_slider_5, z=number_slider_7)
number_slider_8 = DoubleSlider(30, range=0..100 step 0.1)
byCoordinates_5 = Point.ByCoordinates(x=number_slider, y=number_slider_8, z=number_slider_3)
byCoordinates_6 = Point.ByCoordinates(x=number_slider_4, y=number_slider_8, z=number_slider_3)
code_block = CodeBlock(p1=byCoordinates, p2=byCoordinates_2, p3=byCoordinates_3, p4=byCoordinates_4, p5=byCoordinates_5, p6=byCoordinates_6)
# ---------- code_block.designscript (4 lines) ----------
l1 = Line.ByStartPointEndPoint(p1, p2);
l2 = Line.ByStartPointEndPoint(p3, p4);
l3 = Line.ByStartPointEndPoint(p5, p6);
surf = Surface.ByLoft({l1, l2, l3});
# ----------------------------------------
integer_slider = IntegerSlider(7, range=0..50 step 1)
integer_slider_2 = IntegerSlider(5, range=0..50 step 1)
python_script = Python(IN[0]=integer_slider, IN[1]=integer_slider_2)
# ---------- python_script.python (17 lines) ----------
import clr
clr.AddReference('ProtoGeometry')
from Autodesk.DesignScript.Geometry import *
#The inputs to this node will be stored as a list in the IN variables.
u = IN[0]
v = IN[1]

u_step = 1/float(u)
v_step = 1/float(v)

out_UV = []
for i in range(u+1):
    sub_UV =[]
    for j in range(v+1):
        sub_UV.Add(UV.ByCoordinates(i*u_step,j*v_step))
    out_UV.Add(sub_UV)
OUT = out_UV
# ----------------------------------------
U = UV.U(python_script)
V = UV.V(python_script)
pointAtParameter = Surface.PointAtParameter(surface=code_block.surf, u=U, v=V)
python_script_2 = Python(IN[0]=pointAtParameter, IN[1]=integer_slider, IN[2]=integer_slider_2)
# ---------- python_script_2.python (24 lines) ----------
import clr
clr.AddReference('ProtoGeometry')
from Autodesk.DesignScript.Geometry import *
#The inputs to this node will be stored as a list in the IN variables.
points = IN[0]
nb_div_u_direction = IN[1]
nb_div_v_direction = IN[2]
lines=[]
i=0
j=0

for i in range(nb_div_u_direction):
    for j in range(nb_div_v_direction): 
        lines.append(Line.ByStartPointEndPoint(points[i][j],points[i][j+1])) 
        lines.append(Line.ByStartPointEndPoint(points[i][j],points[i+1][j])) 

for i in range(nb_div_v_direction):
    lines.append(Line.ByStartPointEndPoint(points[nb_div_u_direction][i],points[nb_div_u_direction][i+1])) 

for i in range(nb_div_u_direction):
    lines.append(Line.ByStartPointEndPoint(points[i][nb_div_v_direction],points[i+1][nb_div_v_direction]))
    
#Assign your output to the OUT variable.
OUT = lines
# ----------------------------------------
byLine = DynamoSimulation.RSA.AnalyticalModel.AnalyticalBar.ByLine(python_script_2)
sections = SectionBar("B 8x16")
setSectionByName = DynamoSimulation.RSA.AnalyticalModel.AnalyticalBar.SetSectionByName(byLine, sections)
