# Dynamo graph PanelBySurface.dyn (Dynamo 0.9.0.3011)

number_slider = DoubleSlider(0, range=0..100 step 0.1)
number_slider_2 = DoubleSlider(7, range=0..100 step 0.1)
number_slider_3 = DoubleSlider(0, range=0..100 step 0.1)
byCoordinates = Point.ByCoordinates(x=number_slider, y=number_slider_2, z=number_slider_3)
number_slider_4 = DoubleSlider(20, range=0..100 step 0.1)
byCoordinates_2 = Point.ByCoordinates(x=number_slider_4, y=number_slider_2, z=number_slider_3)
number_slider_5 = DoubleSlider(12, range=10..20 step 0.1)
number_slider_6 = DoubleSlider(-10, range=-10..10 step 0.1)
byCoordinates_3 = Point.ByCoordinates(x=number_slider, y=number_slider_5, z=number_slider_6)
number_slider_7 = DoubleSlider(8, range=0..10 step 0.1)
byCoordinates_4 = Point.ByCoordinates(x=number_slider_4, y=number_slider_5, z=number_slider_7)
number_slider_8 = DoubleSlider(30, range=0..100 step 0.1)
byCoordinates_5 = Point.ByCoordinates(x=number_slider, y=number_slider_8, z=number_slider_3)
byCoordinates_6 = Point.ByCoordinates(x=number_slider_4, y=number_slider_8, z=number_slider_3)
code_block = CodeBlock(p1=byCoordinates, p2=byCoordinates_2, p3=byCoordinates_3, p4=byCoordinates_4, p5=byCoordinates_5, p6=byCoordinates_6)
# ---------- code_block.designscript (4 lines) ----------
l1 = Line.ByStartPointEndPoint(p1, p2);
l2 = Line.ByStartPointEndPoint(p3, p4);
l3 = Line.ByStartPointEndPoint(p5, p6);
surf = Surface.ByLoft({l1, l2, l3});
# ----------------------------------------
bySurface = DynamoSimulation.RSA.AnalyticalModel.AnalyticalPanel.BySurface(code_block.surf)
