# Dynamo graph TrussLoads.dyn (Dynamo 0.9.0.3011)

code_block = CodeBlock { "FZ"; }
number_slider = DoubleSlider(5, range=0..20 step 0.1)
number = DoubleInput(5)
code_block_2 = CodeBlock(l=number_slider, amount=number) { 0..l..#amount; }
number_slider_2 = DoubleSlider(2, range=0..2 step 0.1)
byCoordinates = Point.ByCoordinates(x=code_block_2, z=number_slider_2)
byCoordinates_2 = Point.ByCoordinates(x=code_block_2)
byStartPointEndPoint = Line.ByStartPointEndPoint(startPoint=byCoordinates, endPoint=byCoordinates_2)
byLine = DynamoSimulation.RSA.AnalyticalModel.AnalyticalBar.ByLine(byStartPointEndPoint)
startNode = DynamoSimulation.RSA.AnalyticalModel.AnalyticalBar.StartNode(byLine)
case_nature = CaseNature("Dead")
case_type = CaseType("Simple")
code_block_3 = CodeBlock { "test"; }
byNatureAndType = DynamoSimulation.RSA.AnalyticalModel.Loads.LoadCase.ByNatureAndType(case_nature, case_type, code_block_3)
code_block_4 = CodeBlock { -1000; }
byNodes = DynamoSimulation.RSA.AnalyticalModel.Loads.NodalLoad.ByNodes(startNode, byNatureAndType, arg4=code_block_4)
firstItem = List.FirstItem(byCoordinates)
lastItem = List.LastItem(byCoordinates)
byStartPointEndPoint_2 = Line.ByStartPointEndPoint(startPoint=firstItem, endPoint=lastItem)
byLine_2 = DynamoSimulation.RSA.AnalyticalModel.AnalyticalBar.ByLine(byStartPointEndPoint_2)
sections = SectionBar("B 8x16")
setSectionByName = DynamoSimulation.RSA.AnalyticalModel.AnalyticalBar.SetSectionByName(byLine_2, sections)
bar_sections = SectionBar("B 8x16")
setSectionByName_2 = DynamoSimulation.RSA.AnalyticalModel.AnalyticalBar.SetSectionByName(byLine, bar_sections)
code_block_5 = CodeBlock(nb=number) { nb-1; }
removeItemAtIndex = List.RemoveItemAtIndex(list=byCoordinates, indices=code_block_5)
code_block_6 = CodeBlock { 0; }
removeItemAtIndex_2 = List.RemoveItemAtIndex(list=byCoordinates_2, indices=code_block_6)
byStartPointEndPoint_3 = Line.ByStartPointEndPoint(startPoint=removeItemAtIndex, endPoint=removeItemAtIndex_2)
byLine_3 = DynamoSimulation.RSA.AnalyticalModel.AnalyticalBar.ByLine(byStartPointEndPoint_3)
bar_sections_2 = SectionBar("B 8x16")
setSectionByName_3 = DynamoSimulation.RSA.AnalyticalModel.AnalyticalBar.SetSectionByName(byLine_3, bar_sections_2)
firstItem_2 = List.FirstItem(byCoordinates_2)
lastItem_2 = List.LastItem(byCoordinates_2)
byStartPointEndPoint_4 = Line.ByStartPointEndPoint(startPoint=firstItem_2, endPoint=lastItem_2)
byLine_4 = DynamoSimulation.RSA.AnalyticalModel.AnalyticalBar.ByLine(byStartPointEndPoint_4)
bar_sections_3 = SectionBar("B 8x16")
setSectionByName_4 = DynamoSimulation.RSA.AnalyticalModel.AnalyticalBar.SetSectionByName(byLine_4, bar_sections_3)
startNode_2 = DynamoSimulation.RSA.AnalyticalModel.AnalyticalBar.StartNode(setSectionByName_4)
supports = Support("Fixed")
setSupportByName = DynamoSimulation.RSA.AnalyticalModel.AnalyticalNode.SetSupportByName(startNode_2, supports)
endNode = DynamoSimulation.RSA.AnalyticalModel.AnalyticalBar.EndNode(setSectionByName_4)
supports_2 = Support("Fixed")
setSupportByName_2 = DynamoSimulation.RSA.AnalyticalModel.AnalyticalNode.SetSupportByName(endNode, supports_2)
create = List.Create(byNodes, setSectionByName, setSectionByName_2, setSectionByName_3, setSectionByName_4, setSupportByName, setSupportByName_2)
flatten = Flatten(create)
calculate = DynamoSimulation.RSA.Analysis.Calculate(flatten)
getExtremeValuesAndPositionsByLists = DynamoSimulation.RSA.RSAResults.Bar.BarForces.GetExtremeValuesAndPositionsByLists(code_block, calculate.out0, calculate.out3)
