# Dynamo graph Basics_Basic02.dyn (Dynamo 0.8.0.684)

byCoordinates = Point.ByCoordinates()
# note: 可将几何数据可视化为文字信息或三维空间
watch = Watch(byCoordinates)
# note: 使用屏幕右下角的“几何图形/节点”按钮可在三维导航和节点导航之间切换。在“视图”菜单中还可以打开和关闭背景预览
number = DoubleInput(2)
number_slider = DoubleSlider(4.43, range=0..10 step 0.1)
byCoordinates_2 = Point.ByCoordinates(x=number, z=number_slider)
byStartPointEndPoint = Line.ByStartPointEndPoint(startPoint=byCoordinates_2, endPoint=byCoordinates)
watch_3d = Watch3D(byStartPointEndPoint)
byCurve = ModelCurve.ByCurve(byStartPointEndPoint)
# note: Dynamo 通过专用 Revit 节点与 Revit 交互。
# Dynamo 只能创建和修改适合于 Dynamo 关联文件的图元。例如，参考点只能在某些族环境中生成，而模型线几乎可以在任何地方创建。
byPoint = ReferencePoint.ByPoint(byCoordinates_2)
