# Dynamo graph Basics_Basic03.dyn (Dynamo 0.8.0.684)

# note: 数据列表可通过序列和范围来生成。这些列表还可以采用许多其他节点重新组织以实现不同用途
number = DoubleInput(0)
number_2 = DoubleInput(9)
number_3 = DoubleInput(1)
number_range = NumberRange(number, number_2, number_3, lacing=Longest)
watch = Watch(number_range)
number_4 = DoubleInput(3)
chop = List.Chop(number_range, number_4)
watch_2 = Watch(chop)
lastItem = List.LastItem(number_range)
watch_3 = Watch(lastItem)
